% Simulink data dictionary controllerParams.sldd

guidanceParams = Simulink.Parameter(struct(phiCmd_rad=0, thetaCmd_rad=0, psiCmd_rad=0))

innerLoopParams = Simulink.Parameter(struct(
  upRateLimitPitchYaw_dps=180,
  loRateLimitPitchYaw_dps=-180,
  upLimitPitchYaw_deg=45,
  loLimitPitchYaw_deg=-45,
  upRateLimitRoll_dps=90,
  loRateLimitRoll_dps=-90,
  upLimitRoll_deg=5,
  loLimitRoll_deg=-5,
  fbkGainBreakpoints_Pa=[0 5000 100000],
  fbkGainPitchYawP_na=[3600 1800 1200],
  fbkGainPitchYawI_na=[54000 27000 18000],
  fbkGainPitchYawD_na=[0 0 0],
  fbkGainPitchYawN_na=[10 10 10],
  fbkGainRollP_na=[12 6 3.6],
  fbkGainRollI_na=[6 3 1.8],
  fbkGainRollD_na=[0 0 0],
  fbkGainRollN_na=[1 1 1]))

outerLoopParams = Simulink.Parameter(struct(
  upRateLimitPitchYawRate_rps2=0.5,
  loRateLimitPitchYawRate_rps2=-0.5,
  upLimitPitchYawRate_rps=0.05,
  loLimitPitchYawRate_rps=-0.05,
  pitchYawGains=[2 0.5 0 1],
  upRateLimitRollRate_rps2=5,
  loRateLimitRollRate_rps2=-5,
  upLimitRollRate_rps=2,
  loLimitRollRate_rps=-2,
  rollGains=[4 3 0 100]))