% Simulink data dictionary plantParams.sldd

vehicleParams = Simulink.Parameter(struct(mass_kg=18, area_m2=0.018, inertia_kgm2=[8.41 0 0; 0 8.41 0; 0 0 0.053], momentArm_m=[0.384 0 0]))
icParams = Simulink.Parameter(struct(velBdy_mps=[150 10 0], eul_rad=[0 1.570796 0], rateBdy_rps=[1 0 0], posNed_m=[0 0 0]))
envParams = Simulink.Parameter(struct(gravityNed_mps2=[0 0 9.81]))
windParams = Simulink.Parameter(struct(type=1, constantNed_mps=[10; 0; 0]))

aeroParams = Simulink.Parameter(struct(
  cnBreakpoints_na=[-1 -0.9 -0.8 -0.7 -0.6 -0.5 -0.4 -0.3 -0.2 -0.1 0 0.1 0.2 0.3 0.4 0.5 0.6 0.7 0.8 0.9 1],
  cnTable_na=[-8.41471 -7.833269 -7.173561 -6.442177 -5.646425 -4.794255 -3.894183 -2.955202 -1.986693 -0.9983342 0 0.9983342 1.986693 2.955202 3.894183 4.794255 5.646425 6.442177 7.173561 7.833269 8.41471],
  cdBreakpoints_na=[-1 -0.9 -0.8 -0.7 -0.6 -0.5 -0.4 -0.3 -0.2 -0.1 0 0.1 0.2 0.3 0.4 0.5 0.6 0.7 0.8 0.9 1],
  cdTable_na=repmat(0.5, 1, 21)))